# Dynamo graph MEP Supports.dyn "READY TO SHIPE UI Pipe Hangers Sloping Pipe-Updated (2) MINE" (Dynamo 2.10.1.3976)

# group: USER INPUT:
# note: SCRIPT DESCRIPTION:
# -This script will place hangers on any MEP element in the model.
# INSTRUCTIONS:
#     1.) Select Hangers Family
#     2.) Set Spacing between Hangers
#     3.) Select MEP Element Type
#     4.) Press "Run"
select_hangers_family = FamilyTypes("Dynamo Clevis Hanger:Dynamo Clevis Hanger")  # graph input
mep_element_type = ElementTypes("Pipe")
elements_level = Levels("Level 1")
spacing_between_hangers_mm = IntegerSlider(500, range=0..2000 step 1)  # graph input

# group: Retrieving Elements
# note: Gets Elements from a list[0] at a specific level[1]
# **All Elements Of Category Can be applied later
all_elements_of_type = ElementsOfType(element_type=mep_element_type)

# group: Filtering
filters_element_list_by_level = Python(IN[0]=all_elements_of_type, IN[1]=elements_level)  # IronPython2
# ---------- filters_element_list_by_level.python (49 lines) ----------
# Load the Python Standard and DesignScript Libraries
import sys
import clr
clr.AddReference('ProtoGeometry')
from Autodesk.DesignScript.Geometry import *

# The inputs to this node will be stored as a list in the IN variables.
dataEnteringNode = IN

# Place your code below this line
#import clr
clr.AddReference('RevitAPI')
import Autodesk
from Autodesk.Revit.DB import *


clr.AddReference('RevitServices')
import RevitServices
from RevitServices.Persistence import DocumentManager

doc = DocumentManager.Instance.CurrentDBDocument
elements = UnwrapElement(IN[0])
level = UnwrapElement(IN[1])

def filter_elements_by_level(doc, elements, level):
    # Create an empty list to store the filtered elements
    filtered_elements = []
    
    # Loop through all the input elements
    for element in elements:
        # Check if the element has a parameter called "Level"
        if element.LookupParameter("Reference Level"):
            # Get the level of the element
            element_level = element.LookupParameter("Reference Level").AsElementId()
            
            # Check if the element's level matches the input level
            if element_level.IntegerValue == level.Id.IntegerValue:
                filtered_elements.append(element)
    
    return filtered_elements

# Get all the input elements as a list
#elements = FilteredElementCollector(doc).WhereElementIsNotElementType().ToElements()

# Filter the elements based on the input level
filtered_elements = filter_elements_by_level(doc, elements, level)

# Assign your output to the OUT variable.
OUT = filtered_elements
# ----------------------------------------
remove_vertical_elements = Python(IN[0]=filters_element_list_by_level)  # IronPython2
# ---------- remove_vertical_elements.python (28 lines) ----------
# Load the Python Standard and DesignScript Libraries
import sys
import clr
clr.AddReference('ProtoGeometry')
from Autodesk.DesignScript.Geometry import *

clr.AddReference('RevitAPI')
from Autodesk.Revit.DB import *

# Get inputs
elements = IN[0]

# Initialize empty list for horizontal elements
horizontalElements = []

# Loop through elements and check orientation
for elementi in elements:
    element = UnwrapElement(elementi)
    location_curve = element.Location.Curve
    directionZ = location_curve.Direction.Z
    if directionZ != 1 and directionZ != -1:
        horizontalElements.append(element)

# Output horizontal elements
OUT = horizontalElements


#            horizontal_elements.append(UnwrapElement								 (element).Location.Direction.Line)
# ----------------------------------------
element_location_line = Python(IN[0]=remove_vertical_elements)  # "Element Location Line - lineBasedEleOnly"; IronPython2
# ---------- element_location_line.python (28 lines) ----------
import clr
import math
clr.AddReference('RevitAPI')
from Autodesk.Revit.DB import *

clr.AddReference("RevitNodes")
import Revit
clr.ImportExtensions(Revit.GeometryConversion)

items = UnwrapElement(IN[0])

def GetCurvePoints(curve):
    return curve.GetEndPoint(0).ToPoint(), curve.GetEndPoint(1).ToPoint()

def GetCurves(item):
    if hasattr(item, "Curve"):
        return [item.Curve.ToProtoType()]
    elif hasattr(item, "Location") and item.Location and item.Location.ToString() == 'Autodesk.Revit.DB.LocationCurve':
        return [item.Location.Curve.ToProtoType()]
    else:
        return []

outCurves = []
for item in items:
    curves = GetCurves(item)
    outCurves.extend(curves)

OUT = outCurves
# ----------------------------------------

# group: Sets Family Instance Spacing & Location
integer_slider = IntegerSlider(1, range=0..100 step 1)  # graph input
length = Curve.Length(curve=element_location_line)
range = Range(start=integer_slider, end=length, step=spacing_between_hangers_mm, lacing=Longest)
pointAtSegmentLength = Curve.PointAtSegmentLength(curve=element_location_line, segmentLength=range)
byPoint = FamilyInstance.ByPoint(familyType=select_hangers_family, point=pointAtSegmentLength)  # frozen

# group: Get Element Outer Diameter
code_block = CodeBlock { "Outside Diameter"; }
getParameterValueByName = Element.GetParameterValueByName(element=remove_vertical_elements, parameterName=code_block)

# group: Hanger Width
# note: -Sets Hanger Width to match Outside Pipe Diameter.
# -Name should be changed according to the family being used.
code_block_2 = CodeBlock { "Outside Pipe Diameter"; "Hanger Width"; }
setParameterByName = Element.SetParameterByName(element=byPoint, parameterName=code_block_2.out0, value=getParameterValueByName)

# group: Sets Hangers Rotation
startPoint = Curve.StartPoint(curve=element_location_line)
X = Point.X(point=startPoint)
endPoint = Curve.EndPoint(curve=element_location_line)
X_2 = Point.X(point=endPoint)
eq = X == X_2
filterByBoolMask = List.FilterByBoolMask(list=byPoint, mask=eq)
boolean = BoolSelector(false)  # graph input
clean = List.Clean(list=filterByBoolMask.out, preserveIndices=boolean)
code_block_3 = CodeBlock { 90; }
setRotation = FamilyInstance.SetRotation(familyInstance=clean, degree=code_block_3)

add = _ + _  # unwired: x, y

# group: Get the Level Above
# note: Gets  the level above the pipe reference level, where the anchor highest end would be attached,
code_block_4 = CodeBlock { "Reference Level"; }
getParameterValueByName_2 = Element.GetParameterValueByName(element=remove_vertical_elements, parameterName=code_block_4)
level_right_above_anchortop_list = Python(IN[0]=getParameterValueByName_2)  # IronPython2
# ---------- level_right_above_anchortop_list.python (40 lines) ----------
# Load the Python Standard and DesignScript Libraries
import sys
import clr
clr.AddReference('ProtoGeometry')
from Autodesk.DesignScript.Geometry import *

# The inputs to this node will be stored as a list in the IN variables.
dataEnteringNode = IN

# Place your code below this line
#import clr
clr.AddReference('RevitAPI')
import Autodesk
from Autodesk.Revit.DB import *

clr.AddReference('RevitServices')
import RevitServices
from RevitServices.Persistence import DocumentManager

doc = DocumentManager.Instance.CurrentDBDocument

# Get all levels in the document
all_levels = list(FilteredElementCollector(doc).OfClass(Level).WhereElementIsNotElementType().ToElements())

# Sort levels by elevation
all_levels.sort(key=lambda level: level.Elevation)

#New Two LOOps
input_lvls = UnwrapElement(IN[0])
out_levels = []
for input_level in input_lvls:
    input_level = UnwrapElement(input_level)
    for level in all_levels:
        if level.Elevation > input_level.Elevation:
            out_levels.append(level)
            break
    else:
        out_levels.append(None)

OUT = out_levels
# ----------------------------------------
elevation = Level.Elevation(level=level_right_above_anchortop_list)

# group: Current Element Elevation
code_block_5 = CodeBlock { "Reference Level"; }
getParameterValueByName_3 = Element.GetParameterValueByName(element=remove_vertical_elements, parameterName=code_block_5)
elevation_2 = Level.Elevation(level=getParameterValueByName_3)

# group: Element Offset
code_block_6 = CodeBlock { "Top Elevation"; }
getParameterValueByName_4 = Element.GetParameterValueByName(element=remove_vertical_elements, parameterName=code_block_6)
add_2 = getParameterValueByName_4 + elevation_2

# group: Sets Anchor Height
# note: Edit this parameter to match the Parameter height exact name according to family being used.
# **Case Sensitive.
anchor_height_parameter = CodeBlock { "Anchor Elevation"; }
sub = elevation - add_2
setParameterByName_2 = Element.SetParameterByName(element=byPoint, parameterName=anchor_height_parameter, value=sub)

code_block_7 = CodeBlock(IN=setParameterByName_2) { "Try"; vir = IN[0]; }  # frozen
function_apply = ApplyFunction(function=add, argument0=code_block_7.out0)
python_script = Python(IN[0]=select_hangers_family, IN[1]=pointAtSegmentLength)  # IronPython2
# ---------- python_script.python (74 lines) ----------
# Load the Python Standard and DesignScript Libraries
import clr
clr.AddReference('ProtoGeometry')
from Autodesk.DesignScript.Geometry import *

# The inputs to this node will be stored as a list in the IN variables.
family_type = IN[0]  # Autodesk.Element.FamilyType
points = IN[1]  # List of lists of Autodesk.DesignScript.Geometry.Point

# Place your code below this line
import sys
clr.AddReference('RevitAPI')
from Autodesk.Revit.DB import *
import Autodesk
clr.AddReference('RevitServices')
import RevitServices
from RevitServices.Persistence import DocumentManager
from RevitServices.Transactions import TransactionManager

doc = DocumentManager.Instance.CurrentDBDocument

# Convert family type to Revit API element
family_type_element = UnwrapElement(family_type)

# Import StructuralType enum
from Autodesk.Revit.DB.Structure import StructuralType

# Place family instances at each point
instance_list = []

#tg = TransactionGroup(doc, "Create Family Instances")
#tg.Start()

try:
    for point_list in points:
        instance_sublist = []
        
        for point in point_list:
            unwrapped_point = UnwrapElement(point)
            x = unwrapped_point.X
            y = unwrapped_point.Y
            z = unwrapped_point.Z
            xyz = XYZ(x, y, z)
            
#            t = Transaction(doc, "Create Family Instance")
#            t.Start()
            TransactionManager.Instance.EnsureInTransaction(doc)
            
            try:
                instance = doc.Create.NewFamilyInstance(xyz, family_type_element, StructuralType.NonStructural)
                # Customize additional properties of the instance if needed
                instance_sublist.append(instance)
#                t.Commit()
                TransactionManager.Instance.TransactionTaskDone()
            
            except:
                TransactionManager.Instance.TransactionTaskDone()
#                t.Commit()
#                t.RollBack()
                raise
        
        instance_list.append(instance_sublist)
    
#    tg.Assimilate()

#except Exception as ex:
#    raise Exception("Error occurred: " + str(ex))

finally:
#    if tg.IsValidObject:
#        tg.Assimilate()
#        tg.RollBack()

    OUT = instance_list
# ----------------------------------------
code_block_8 = CodeBlock { 0; }
getItemAtIndex = List.GetItemAtIndex(list=pointAtSegmentLength, index=code_block_8)
list_create = List.Create(item0=getItemAtIndex)
